# Grasshopper definition Ros_PingPong_Trajectory.gh (Grasshopper 1.0.7)
# plug-ins: Volvox, Kangaroo2 Components, Human

httpin = HttpInput(Start=False, Prefix="http://localhost:8080/bengesht/")  # -> Keys, Values, ListenerObject
websocket_client_receiver = WebsocketClientReceiver(AutoUpdate=True)  # -> Message, Status
websocket_client_start = WebsocketClientStart(InitalMessage="Hello World", Reset=False)
httpout = HttpOutput()
websocket_client_sender = WebsocketClientSender(Message="Hello World")
panel = Panel("""0,0,2
0,2,1""")
publish_string = PublishString()  # -> R
# ---------- publish_string: Python ----------
import json


data = {
"op":"publish",
"topic":Topic,
"msg":{
    "data":Msg
}
}

R = json.dumps(data)
# ---------- end publish_string ----------
python = GhPythonScript()  # -> Out, A
panel_2 = Panel(publish_string)

# ---- group: Define
ros_topic_types = ROSTopicTypes({"String": "std_msgs/String", "Twist": "geometry_msgs/Twist"}, selected="String")
call_service = CallService()  # -> R
# ---------- call_service: Python ----------
import json


data = {
"op":"call_service",
"service":Service
}

if(Args is not None):
    data['args'] = json.loads(Args)

R = json.dumps(data)
# ---------- end call_service ----------
unadvertise = Unadvertise()  # -> R
# ---------- unadvertise: Python ----------
import json


data = {
"op":"unadvertise",
"topic":Topic
}

R = json.dumps(data)
# ---------- end unadvertise ----------
advertise = Advertise()  # -> R
# ---------- advertise: Python ----------
import json


data = {
"op":"advertise",
"topic":Topic,
"type":Type
}

R = json.dumps(data)
# ---------- end advertise ----------

# ----
crv = Curve(<curve referenced from the Rhino model>)
divide = DivideCurve(Curve=crv, Count=Slider(50, range=0..100), Kinks=False)  # -> Points, Tangents, Parameters
websocket_client_start_2 = WebsocketClientStart(Address="ws://10.10.42.225:8080/", InitalMessage="Hello World", Reset=Button())
websocket_client_receiver_2 = WebsocketClientReceiver(WebsocketObjects=websocket_client_start_2, AutoUpdate=True)  # -> Message, Status

# ---- group: Publish
publish_twist = PublishTwist()  # -> R
# ---------- publish_twist: Python ----------
import json


data = {
"op":"publish",
"topic":topic,
"msg":{
    "angular":{"x":(AX or 0), "y":(AY or 0), "z":(AZ or 0)},
    "linear":{"x":(LX or 0), "y":(LY or 0), "z":(LZ or 0)},
}
}

R = json.dumps(data)
# ---------- end publish_twist ----------
publish_string_2 = PublishString()  # -> R; same code as publish_string

# ----
python_2 = GhPythonScript(x=websocket_client_receiver_2.Message)  # -> out, a, oPt, oArrived
# ---------- python_2: Python ----------
__author__ = "shabe"
__version__ = "2021.03.09"

import rhinoscriptsyntax as rs

def PoseCallBack(x):
    pass

def ArrivedCallBack(x):
    pass

 

"""
for d in x:
    print d.split(":")[1],d.split(":")[1]== " data"
    if d.split(":")[1]== ' data':
        print d.split(":")[2]
        if d.split(":")[2]==' go':
            print d.split(":")[2]
            a = "yo go"
        else:
            a = ""
            
"""


def CleanX(x):
    data  =  x.split('**')[1]
    if len(data.split(','))==3:
        topic = 'pt'
        data = data.split(',')
        data = rs.AddPoint(float(data[0]),float(data[1]),float(data[2]))
    else:
        topic = 'arrived'
        if data =='False':
            data = False
        else:
            data = True
    return topic,data
        
    
    
    
topic,data = CleanX(x)
if topic == 'pt':
    oPt = data
else:
    oArrived = data
# ---------- end python_2 ----------
panel_3 = Panel(python_2.a)
crv_2 = Curve(<curve referenced from the Rhino model>)
panel_4 = Panel(websocket_client_receiver_2.Message)
command_line = CommandLine(Run=True)  # disabled

# ---- group: Parse
parse_twist = ParseTwist()  # -> LX, LY, LZ, AX, AY, AZ
# ---------- parse_twist: Python ----------
import json

try:
    jsonObj = json.loads(M)["msg"];
    
    LX = jsonObj["linear"]["x"]
    LY = jsonObj["linear"]["y"]
    LZ = jsonObj["linear"]["z"]
    
    AX = jsonObj["angular"]["x"]
    AY = jsonObj["angular"]["y"]
    AZ = jsonObj["angular"]["z"]
except:
    LX = None
    LY = None
    LZ = None
    
    AX = None
    AY = None
    AZ = None
# ---------- end parse_twist ----------
parse_string = ParseString()  # -> data
# ---------- parse_string: Python ----------
import json

try:
    jsonObj = json.loads(M)["msg"];
    
    data = jsonObj["data"]
except:
    data = None
# ---------- end parse_string ----------

# ----
panel_5 = Panel(python_2.oPt)
pt = Point(python_2.oPt)
toggle = BooleanToggle(True)
subscribe = Subscribe()  # -> R
# ---------- subscribe: Python ----------
import json


data = {
"op":"subscribe",
"topic":Topic
}

R = json.dumps(data)
# ---------- end subscribe ----------
unsubscribe = Unsubscribe()  # -> R
# ---------- unsubscribe: Python ----------
import json


data = {
"op":"unsubscribe",
"topic":Topic
}

R = json.dumps(data)
# ---------- end unsubscribe ----------
frames = CurveFrames(Curve=crv_2, Count=Slider(30, range=0..100))  # -> Frames, Parameters
clean = CleanTree(RemoveNulls=toggle, RemoveInvalid=toggle, RemoveEmpty=toggle, Tree=pt)
python_3 = GhPythonScript(x=python_2.oArrived, y=divide.Points, z=Button())  # -> out, a; inputs y: list
# ---------- python_3: Python ----------
__author__ = "shabe"
__version__ = "2021.03.10"

import rhinoscriptsyntax as rs
if z:
    counter =0
    oPt = y[counter]
    TrueQ = []

if x == True:
    print len(TrueQ)
    print "here"
    TrueQ.append(x)
if len(TrueQ)>10:
    TrueQ = []
    counter+=1
a = y[counter]
# ---------- end python_3 ----------
panel_6 = Panel(websocket_client_start_2)
rec = DataRecorder(clean, DataLimit=-10, RecordData=True)
duppt = RemoveDuplicatePts(Points=rec, Tolerance=0.01)
panel_7 = Panel(python_3.a)
pline = PolyLine(Vertices=duppt, Closed=False)
panel_8 = Panel("asdasfd")
previewlw = CustomPreviewLineweights(Geometry=pline, Shader=ColourSwatch(SwatchColor=RGB(10, 0, 0)), Absolute=False)
panel_9 = Panel("20,35,-1")
trigger = Trigger(Interval=100, TimerInterval=100, Target=publish_string_3)
publish_string_3 = PublishString(Topic="/soft2/NextPoints", Msg=python_3.a)  # -> R; same code as publish_string
subscribe_2 = Subscribe(Topic="/soft2/pose")  # -> R; same code as subscribe
subscribe_3 = Subscribe(Topic="/soft2/arrived")  # -> R; same code as subscribe

# ---- group: Points cloud receiving
websocket_client_sender_2 = WebsocketClientSender(WebsocketObjects=websocket_client_start_2, Message=subscribe_3)

# ----
websocket_client_sender_3 = WebsocketClientSender(WebsocketObjects=websocket_client_start_2, Message=publish_string_3)
websocket_client_sender_4 = WebsocketClientSender(WebsocketObjects=websocket_client_start_2, Message=subscribe_2)
