# Grasshopper definition Ros_Publish_Trajectory.gh (Grasshopper 1.0.7)
# plug-ins: Volvox

panel = Panel("""0,0,2
0,2,1""")

# ---- group: Drone control-/cmd_vel
number_slider = Slider(0.59, range=-10..10)  # disabled
number_slider_2 = Slider(-10, range=-10..10)  # disabled
number_slider_3 = Slider(-10, range=-10..10)  # disabled
number_slider_4 = Slider(0, range=0..10)  # disabled
panel_2 = Panel("/cmd_vel")  # disabled
number_slider_5 = Slider(0, range=0..10)  # disabled
number_slider_6 = Slider(0, range=0..10)  # disabled
number_slider_7 = Slider(0, range=0..10)  # disabled
number_slider_8 = Slider(0, range=0..10)  # disabled
number_slider_9 = Slider(0, range=0..10)  # disabled
publish_twist = PublishTwist(
    topic=panel_2,
    LX=number_slider,
    LY=number_slider_2,
    LZ=number_slider_3,
    AX=number_slider_8,
    AY=number_slider_4,
    AZ=number_slider_9)  # -> R; disabled
# ---------- publish_twist: Python ----------
import json


data = {
"op":"publish",
"topic":topic,
"msg":{
    "angular":{"x":(AX or 0), "y":(AY or 0), "z":(AZ or 0)},
    "linear":{"x":(LX or 0), "y":(LY or 0), "z":(LZ or 0)},
}
}

R = json.dumps(data)
# ---------- end publish_twist ----------
panel_3 = Panel(publish_twist)  # disabled

# ----
panel_4 = Panel("/waypoints")  # disabled
number_slider_10 = Slider(0, range=0..10)  # disabled
number_slider_11 = Slider(0, range=0..10)  # disabled
number_slider_12 = Slider(0, range=0..10)  # disabled
publish_twist_2 = PublishTwist(topic=panel_4)  # -> R; disabled; same code as publish_twist
panel_5 = Panel(publish_twist_2)  # disabled

panel_6 = Panel("ws://192.168.1.83:8080/")
panel_7 = Panel("ws://127.0.0.1:8080/")
panel_8 = Panel("ws://192.168.56.1:8080/")
panel_9 = Panel("\"ws://0.0.0.0:8080/")
panel_10 = Panel("/ardrone/takeoff")
publish_string = PublishString(Topic="/waypoints")  # -> R
# ---------- publish_string: Python ----------
import json


data = {
"op":"publish",
"topic":Topic,
"msg":{
    "data":Msg
}
}

R = json.dumps(data)
# ---------- end publish_string ----------
httpin = HttpInput(Start=False, Prefix="http://localhost:8080/bengesht/")  # -> Keys, Values, ListenerObject
publish_twist_3 = PublishTwist(topic="/waypoints", X=Slider(0, range=0..10), Y=Slider(0, range=0..10), Z=Slider(2, range=0..10))  # -> R; disabled; same code as publish_twist
websocket_client_receiver = WebsocketClientReceiver(AutoUpdate=True)  # -> Message, Status
websocket_client_start = WebsocketClientStart(InitalMessage="Hello World", Reset=False)
httpout = HttpOutput()
websocket_client_start_2 = WebsocketClientStart(Address="ws://192.168.43.115:8080/", InitalMessage="Hello World", Reset=Button())
websocket_client_sender = WebsocketClientSender(Message="Hello World")
panel_11 = Panel(publish_string)

# ---- group: Points cloud receiving
panel_12 = Panel("/orb_slam2_mono/map_points")  # disabled
subscribe = Subscribe(Topic=panel_12)  # -> R; disabled
# ---------- subscribe: Python ----------
import json


data = {
"op":"subscribe",
"topic":Topic
}

R = json.dumps(data)
# ---------- end subscribe ----------
websocket_client_sender_2 = WebsocketClientSender(WebsocketObjects=websocket_client_start_2, Message=subscribe)  # disabled
websocket_client_receiver_2 = WebsocketClientReceiver(WebsocketObjects=websocket_client_start_2, AutoUpdate=True)  # -> Message, Status; disabled

# ----
python = GhPythonScript()  # -> Out, A

# ---- group: Define
ros_topic_types = ROSTopicTypes({"String": "std_msgs/String", "Twist": "geometry_msgs/Twist"}, selected="String")
call_service = CallService()  # -> R
# ---------- call_service: Python ----------
import json


data = {
"op":"call_service",
"service":Service
}

if(Args is not None):
    data['args'] = json.loads(Args)

R = json.dumps(data)
# ---------- end call_service ----------
advertise = Advertise()  # -> R
# ---------- advertise: Python ----------
import json


data = {
"op":"advertise",
"topic":Topic,
"type":Type
}

R = json.dumps(data)
# ---------- end advertise ----------
unadvertise = Unadvertise()  # -> R
# ---------- unadvertise: Python ----------
import json


data = {
"op":"unadvertise",
"topic":Topic
}

R = json.dumps(data)
# ---------- end unadvertise ----------

# ----
websocket_client_sender_3 = WebsocketClientSender(WebsocketObjects=websocket_client_start_2, Message=publish_string)

# ---- group: Publish
publish_twist_4 = PublishTwist()  # -> R; same code as publish_twist
publish_string_2 = PublishString()  # -> R; same code as publish_string

# ----
command_line = CommandLine(Run=True)  # disabled

# ---- group: Parse
subscribe_2 = Subscribe()  # -> R; same code as subscribe
parse_twist = ParseTwist()  # -> LX, LY, LZ, AX, AY, AZ
# ---------- parse_twist: Python ----------
import json

try:
    jsonObj = json.loads(M)["msg"];
    
    LX = jsonObj["linear"]["x"]
    LY = jsonObj["linear"]["y"]
    LZ = jsonObj["linear"]["z"]
    
    AX = jsonObj["angular"]["x"]
    AY = jsonObj["angular"]["y"]
    AZ = jsonObj["angular"]["z"]
except:
    LX = None
    LY = None
    LZ = None
    
    AX = None
    AY = None
    AZ = None
# ---------- end parse_twist ----------
parse_string = ParseString()  # -> data
# ---------- parse_string: Python ----------
import json

try:
    jsonObj = json.loads(M)["msg"];
    
    data = jsonObj["data"]
except:
    data = None
# ---------- end parse_string ----------
unsubscribe = Unsubscribe()  # -> R
# ---------- unsubscribe: Python ----------
import json


data = {
"op":"unsubscribe",
"topic":Topic
}

R = json.dumps(data)
# ---------- end unsubscribe ----------
