# Grasshopper definition Visualize_Generate Tranjectory from PointCloud.gh (Grasshopper 1.0.7)
# plug-ins: CockroachGH

path = FilePath("D:\Go Abroad\04 IaaC_Term 2\01 Software\03 Project Files\Shahar Code\soft2_compiled_1615307126_734546.csv")
file = ReadFile(File=path, PerLineParse=True)
panel = Panel(path)
panel_2 = Panel(file)
split = TextSplit(Text=file, Separators=" ")
item = ListItem(List=split, Index=0, Wrap=True)  # -> Item, Item1, Item2
pt = ConstructPoint(XCoordinate=item.Item, YCoordinate=item.Item1, ZCoordinate=item.Item2)  # -> flatten(Point)
panel_3 = Panel(split)
create = CloudCreate(Points=pt)
cloud = PointCloud(create)
panel_4 = Panel(cloud)
preview = CustomPreview(Geometry=create, Material=ColourSwatch(SwatchColor=RGB(227, 227, 227)))
colour = ColourPicker(PickedColour=RGB(64, 64, 64))
crv = Curve(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)
cloudpolygoncrop = CloudPolygonCrop(PointCloud=cloud, Polylines=crv, Inverse=Toggle(False))
cloudpreview = CloudPreview(PointCloud=cloudpolygoncrop, Colors=colour, Thickness=2)
colour_2 = ColourPicker(PickedColour=RGB(69, 69, 69))
brep = Brep(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)
edges = BrepEdges(Brep=brep)  # -> Naked, Interior, NonManifold
preview_2 = CustomPreview(Geometry=[edges.Interior, crv], Material=ColourSwatch(SwatchColor=RGB(140, 140, 140)))
cloudboxcrop = CloudBoxCrop(PointCloud=cloudpolygoncrop, Boxes=brep, Inverse=Toggle(False))
cloudpreview_2 = CloudPreview(PointCloud=cloudboxcrop, Colors=colour_2, Thickness=2)
cloud_2 = PointCloud(cloudboxcrop)
crv_2 = Curve(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)
panel_5 = Panel(cloud_2)
pframes = PerpFrames(Curve=crv_2, Count=Slider(19, range=0..20), Align=True)  # -> Frames, Parameters
neg = Negative(Value=Slider(0.3, range=0..1))
cloudsection = CloudSection(PointCloud=cloud_2, Planes=graft(pframes.Frames), Tolerance=neg)
cloud_3 = PointCloud(flatten(cloudsection))
cloudmerge = CloudMerge(PointCloud=cloud_3)
explode = CloudExplode(PointCloud=cloudsection)  # -> Points, Normals, Colors
panel_6 = Panel(cloud_3)
panel_7 = Panel(cloudmerge)
plfit = PlaneFit(Points=explode.Points)  # -> Plane, Deviation
hull = ConvexHull(Points=explode.Points, Plane=plfit.Plane)  # -> flatten(Hull), HullZ, Indices
debrep = DeconstructBrep(Brep=hull.Hull)  # -> Faces, Edges, Vertices
pdecon = Deconstruct(Point=debrep.Vertices)  # -> XComponent, YComponent, ZComponent
sort = SortList(Keys=pdecon.ZComponent, ValuesA=debrep.Vertices)  # -> Keys, ValuesA
lng = ListLength(List=cloud_3)
item_2 = ListItem(List=sort.ValuesA, Index=0, Wrap=True)  # -> Item1, Item
subtraction = Subtraction(A=lng, B=Slider(1, range=0..1))
ln = Line(StartPoint=item_2.Item1, EndPoint=item_2.Item)
range = Range(Domain=Domain(0, 1), Steps=subtraction)
gradient = Gradient(
    LowerLimit=0,
    UpperLimit=1,
    Parameter=range,
    stops=[0: RGB(243, 57, 0), 0.1: RGB(236, 27, 60), 0.2: RGB(210, 0, 118), 0.3: RGB(103, 0, 120), 0.4: RGB(39, 72, 161), 0.5: RGB(1, 192, 229), 0.6: RGB(18, 178, 90), 0.7: RGB(79, 186, 8), 0.8: RGB(220, 237, 32), 0.9: RGB(247, 159, 20), 1: RGB(243, 57, 0)])
cull = CullPattern(List=flatten(item_2.Item), CullPattern=[False, True])
cull_2 = CullPattern(List=flatten(item_2.Item), CullPattern=invert([False, True]))
cull_3 = CullPattern(List=flatten(item_2.Item1), CullPattern=[False, True])
cull_4 = CullPattern(List=flatten(item_2.Item1), CullPattern=invert([False, True]))
panel_8 = Panel(range)
shift = ShiftList(List=cull_4, Shift=1, Wrap=True)
ln_2 = Line(StartPoint=shift, EndPoint=cull_3)
ln_3 = Line(StartPoint=cull, EndPoint=cull_2)
cull_i = CullIndex(List=ln_2, Indices="-1", Wrap=True)
cloudpreview_3 = CloudPreview(PointCloud=cloud_3, Colors=gradient, Thickness=2)
join = JoinCurves(Curves=[cull_i, ln_3, ln], Preserve=False)
preview_3 = CustomPreview(Geometry=join, Material=ColourSwatch(SwatchColor=RGB(0, 0, 0)))

explode_2 = CloudExplode(PointCloud=cloudboxcrop)  # -> Points, Normals, Colors
pdecon_2 = Deconstruct(Point=explode_2.Points)  # -> XComponent, YComponent, ZComponent
lng_2 = ListLength(List=pdecon_2.ZComponent)
sort_2 = SortList(Keys=pdecon_2.ZComponent, ValuesA=explode_2.Points)  # -> Keys, ValuesA
range_2 = Range(Domain=Domain(0, 1), Steps=lng_2)
gradient_2 = Gradient(
    LowerLimit=0,
    UpperLimit=1,
    Parameter=range_2,
    stops=[0: RGB(234, 38, 0), 0.25: RGB(234, 126, 0), 0.5: RGB(254, 244, 84), 0.75: RGB(173, 203, 249)])

msphere = MeshSphere(Base=sort_2.ValuesA, Radius=0.005, UCount=10, VCount=20)

preview_4 = CustomPreview(Geometry=msphere, Material=gradient_2)
