# Grasshopper definition Visualize_Location & Orients Csv to GH.gh (Grasshopper 1.0.7)
# plug-ins: CockroachGH

# Location
path = FilePath("D:\Go Abroad\04 IaaC_Term 2\01 Software\03 Project Files\Shahar Code\loc1.csv")
# Orient
path_2 = FilePath("D:\Go Abroad\04 IaaC_Term 2\01 Software\03 Project Files\Shahar Code\orient.csv")
file = ReadFile(File=path, PerLineParse=True)
file_2 = ReadFile(File=path_2, PerLineParse=False)
panel = Panel(file)
panel_2 = Panel(file_2)
panel_3 = Panel(path_2)
split = TextSplit(Text=file_2, Separators=">")
cull = CullPattern(List=split, CullPattern=[False, True, False])
cull_2 = CullPattern(List=split, CullPattern=[False, False, True])
cull_3 = CullPattern(List=split, CullPattern=[True, False, False])
panel_4 = Panel(cull_3)
panel_5 = Panel(cull)
panel_6 = Panel(cull_2)
split_2 = TextSplit(Text=file, Separators="**")

len = TextLength(Text=split_2)
cull_4 = CullPattern(List=split_2, CullPattern=len)
item = ListItem(List=cull_4, Index=0, Wrap=True)  # -> Item, Item1, Item2

item_2 = ListItem(List=split_2, Index=0, Wrap=True)  # -> Item, Item1, Item2, Item3, Item4
split_3 = TextSplit(Text=flatten(item_2.Item), Separators="x:")
split_4 = TextSplit(Text=flatten(item_2.Item2), Separators="y:")
split_5 = TextSplit(Text=flatten(item_2.Item4), Separators="z:")
split_6 = TextSplit(Text=cull_3, Separators="x:<")
split_7 = TextSplit(Text=cull, Separators=",y:<")
split_8 = TextSplit(Text=cull_2, Separators=",y:<")
item_3 = ListItem(List=split_6, Index=0, Wrap=True)  # -> Item1, Item
item_4 = ListItem(List=split_7, Index=0, Wrap=True)  # -> Item3, Item2, Item1, Item
item_5 = ListItem(List=split_8, Index=0, Wrap=True)  # -> Item3, Item2, Item1, Item
item_6 = ListItem(List=split_4, Index="-1", Wrap=True)
item_7 = ListItem(List=split_5, Index="-1", Wrap=True)
item_8 = ListItem(List=split_3, Index="-1", Wrap=True)
pt = ConstructPoint(XCoordinate=item_8, YCoordinate=item_6, ZCoordinate=item_7)  # -> flatten(Point)
split_9 = TextSplit(Text=item_3.Item1, Separators=",")
panel_7 = Panel(split_9)
merge = Merge(Data1=item_4.Item3, Data2=item_4.Item2, Data3=item_4.Item1)
merge_2 = Merge(Data1=item_5.Item3, Data2=item_5.Item2, Data3=item_5.Item1)
panel_8 = Panel(merge)
item_9 = ListItem(List=split_9, Index=0, Wrap=True)  # -> flatten(Item), flatten(Item1), flatten(Item2)
item_10 = ListItem(List=merge_2, Index=0, Wrap=True)  # -> flatten(Item), flatten(Item1), flatten(Item2)
item_11 = ListItem(List=merge, Index=0, Wrap=True)  # -> flatten(Item), flatten(Item1), flatten(Item2)
Y = UnitY(Factor=Slider(-0.349, range=-2..2))
X = UnitX(Factor=Slider(1.107, range=-2..2))
panel_9 = Panel(merge_2)
move = Move(Geometry=pt, Motion=X)  # -> Geometry, Transform
cull_i = CullIndex(List=item_9.Item2, Indices=-1, Wrap=True)
cull_i_2 = CullIndex(List=item_9.Item, Indices=-1, Wrap=True)
cull_i_3 = CullIndex(List=item_9.Item1, Indices=-1, Wrap=True)
move_2 = Move(Geometry=move.Geometry, Motion=Y)  # -> Geometry, Transform
pt_2 = ConstructPoint(XCoordinate=item_11.Item, YCoordinate=item_11.Item1, ZCoordinate=item_11.Item2)
pt_3 = ConstructPoint(XCoordinate=item_10.Item, YCoordinate=item_10.Item1, ZCoordinate=item_10.Item2)
pt_4 = ConstructPoint(XCoordinate=0, YCoordinate=0, ZCoordinate=0)
pt_5 = ConstructPoint(XCoordinate=cull_i_2, YCoordinate=cull_i_3, ZCoordinate=cull_i)
create = CloudCreate(Points=move_2.Geometry)
shift = ShiftList(List=move_2.Geometry, Shift=1, Wrap=True)  # -> flatten(List)
ln = Line(StartPoint=pt_4, EndPoint=pt_5)
ln_2 = Line(StartPoint=pt_4, EndPoint=pt_2)
ln_3 = Line(StartPoint=pt_4, EndPoint=pt_3)
number_slider = Slider(0.015, range=0..1)
ln_4 = Line(StartPoint=move_2.Geometry, EndPoint=shift)
lng = ListLength(List=move_2.Geometry)
cloudpreview = CloudPreview(PointCloud=create, Colors=ColourSwatch(SwatchColor=RGB(0, 0, 0)), Thickness=3)
panel_10 = Panel(lng)
line = LineSDL(Start=pt_4, Direction=ln, Length=number_slider)
line_2 = LineSDL(Start=pt_4, Direction=ln_2, Length=number_slider)
line_3 = LineSDL(Start=pt_4, Direction=ln_3, Length=number_slider)
vdisex = VectorDisplayEx(Point=move_2.Geometry, Vector=ln_4, Colour=ColourSwatch(SwatchColor=RGB(181, 181, 181)), Width=1)
orient = Orient(Geometry=line, Source=pt_4, Target=move_2.Geometry)  # -> Geometry, Transform
orient_2 = Orient(Geometry=line_2, Source=pt_4, Target=move_2.Geometry)  # -> Geometry, Transform
orient_3 = Orient(Geometry=line_3, Source=pt_4, Target=move_2.Geometry)  # -> Geometry, Transform
preview = CustomPreview(Geometry=orient_3.Geometry, Material=ColourSwatch(SwatchColor=RGB(0, 47, 255)))
preview_2 = CustomPreview(Geometry=orient.Geometry, Material=ColourSwatch(SwatchColor=RGB(255, 0, 0)))
preview_3 = CustomPreview(Geometry=orient_2.Geometry, Material=ColourSwatch(SwatchColor=RGB(144, 255, 0)))
